# Grasshopper definition BroExempel.gh (Grasshopper 0.9.76)
# plug-ins: Karamba, MiStrAnGH

pt = ConstructPoint(XCoordinate=0, YCoordinate=0, ZCoordinate=0)
ln = Line()
srf = Surface(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)
srf_2 = Surface(<surface referenced from the Rhino model>)
number_slider = Slider(100, range=0..500)
scale = Scale(Geometry=srf, Center=Point(0, 0, 0), Factor=Slider(1, range=0..1))  # -> Geometry, Transform
srf_3 = Surface(scale.Geometry)
division = Division(A=number_slider, B=4)
sdivide = DivideSurface(Surface=srf_3, UCount=number_slider, VCount=division)  # -> Points, Normals, Parameters
mesh_uv = MeshSurface(Surface=srf_3, UCount=number_slider, VCount=division, Overhang=True, Equalize=False)
number_slider_2 = Slider(2000, range=0..2000)
tri = Triangulate(Mesh=mesh_uv)  # -> Mesh, Count
mesh = Mesh(tri.Mesh)
medges = MeshEdges(Mesh=mesh)  # -> NakedEdges, InteriorEdges, NonManifoldEdges
demesh = DeconstructMesh(Mesh=mesh)  # -> Vertices, Faces, Colours, Normals
tstat = TreeStatistics(Tree=sdivide.Points)  # -> Paths, Length, Count
lng = ListLength(List=tstat.Length)
division_2 = Division(A=lng, B=2)
medges_2 = MeshEdges(Mesh=tri.Mesh)  # -> NakedEdges, InteriorEdges, NonManifoldEdges
X = UnitX(Factor=number_slider_2)
item = ListItem(List=tstat.Paths, Index=0, Wrap=True)  # -> Item1, Item
Z = UnitZ(Factor=number_slider_2)
item_2 = ListItem(List=tstat.Paths, Index=division_2, Wrap=True)
meshtoshell = MeshToShellKaramba(Point=demesh.Vertices, Mesh=mesh, LDist=0.005)  # -> Point, Element, Info
branch = TreeBranch(Tree=sdivide.Points, Path=item_2, MaintainPaths=True)
branch_2 = TreeBranch(Tree=sdivide.Points, Path=item.Item1, MaintainPaths=True)
branch_3 = TreeBranch(Tree=sdivide.Points, Path=item.Item, MaintainPaths=True)
bc_points = Point(flatten([branch_2, branch_3]))
cp = ClosestPoint(Point=bc_points, Cloud=demesh.Vertices)  # -> ClosestPoint, CPIndex, Distance
supp = SupportKaramba(PosInd=cp.CPIndex, menu=[buttons(on, on, on, on, on, on)])
number_slider_3 = Slider(10, range=0..10)
lng_2 = ListLength(List=branch)
number_slider_4 = Slider(0.01, range=0..0.01)
division_3 = Division(A=lng_2, B=3)
number_slider_5 = Slider(9, range=0..10)
index = ItemIndex(List=meshtoshell.Point, Item=meshtoshell.Point)
matprops = MaterialPropertiesKaramba(
    ElementsIdentifiers=index,
    YoungsModulus_kN_cm2=21000,
    ShearModulus_kN_cm2=8076,
    SpecificWeight_kN_m3=Slider(0, range=0..100),
    CoefficientOfThermalExpansion_1_C=1e-05,
    YieldStrength_kN_cm2=Slider(500, range=0..1000),
    Name="S235")
shift = ShiftList(List=branch, Shift=division_3, Wrap=False)
neg = Negative(Value=division_3)
shift_2 = ShiftList(List=shift, Shift=neg, Wrap=False)
load_pts = Point(flatten(shift_2))
cp_2 = ClosestPoint(Point=load_pts, Cloud=demesh.Vertices)  # -> ClosestPoint, CPIndex, Distance
lng_3 = ListLength(List=shift_2)
division_4 = Division(A=Slider(100000, range=0..1000000), B=lng_3)
bc = Point(flatten([branch_2, branch_3]))
dup = DuplicateData(Data=division_4, Number=lng_3, Order=True)
mesh_2 = Mesh(tri.Mesh)
cross_sections = CrossSectionsKaramba(Heights_cm=Slider(1, range=0..1), mode="Shell")
neg_2 = Negative(Value=dup)
Z_2 = UnitZ(Factor=neg_2)
force_vecs = Vector(Z_2)
division_5 = Division(A=force_vecs, B=1000)
loads = LoadsKaramba(ForceVector=division_5, Local=True, PosInd=cp_2.CPIndex, LCase=0, mode="Point")
assemble = AssembleModelKaramba(
    Point=meshtoshell.Point,
    Elem=meshtoshell.Element,
    Support=supp,
    Load=loads,
    CrossSection=cross_sections,
    Material=matprops,
    LimitDistance_m=0.005)  # -> Model, Info, Mass_kg, CenterOfGravity
analyzethi = AnalyzeThIKaramba(Model=assemble.Model)  # -> CalculatedModel, MaximumDisplacement_m, ResultingForceOfGravity_kN, ElasticEnergy_kNm
karamba = Panel(analyzethi.MaximumDisplacement_m)
pointload = MiStrAnPointload(Point=shift_2, ForceVector=Z_2)
nodedisp = NodalDisplacementsKaramba(AnalyzedModel=analyzethi.CalculatedModel)  # -> AnalyzedModel, NodalTranslations_m, NodalRotations_rad
support = CreateSupport(
    Point=bc,
    SupportInXDirection=True,
    SupportInYDirection=True,
    SupportInZDirection=True,
    SupportInXXDirection=True,
    SupportInYYDirection=True,
    SupportInZZDirection=True)
modelview = ModelViewKaramba(Model=nodedisp.AnalyzedModel, LoadCaseFactorsForLinearSuperposition=1, IndexIncrementOfVisibleLoadcase=0)  # -> Model, DeformedMesh, DeformedAxes, DeformedModel
section = Section(
    EModulusInLongitudinalDirection_GPa=210,
    EModulusInTransverseDirection_GPA=210,
    LongitudinalShearModulus_GPA=79.3,
    PoissonsRatio=0.3,
    LaminaThickness_mm=Slider(10, range=0..10),
    Angles_degree=0,
    Density_kg_m_3=7800)
assemble_2 = MiStrAnAssembleStructure(Mesh=mesh_2, MiStrAnSupports=support, MiStrAnLoads=pointload, GeneratedSection=section)
multiplication = Multiplication(A=nodedisp.NodalTranslations_m, B=1000)
demesh_2 = DeconstructMesh(Mesh=mesh)  # -> Vertices, Faces, Colours, Normals
move = Move(Geometry=demesh_2.Vertices, Motion=multiplication)  # -> Geometry, Transform
conmesh = ConstructMesh(Vertices=move.Geometry, Faces=demesh_2.Faces)
analyse = MiStrAnAnalyseStructure(Run=Toggle(True), MiStrAnStructure=assemble_2)  # -> AnalysedStructure, Displacements, Rotations, Reactions, PrincipalStresses
vlen = VectorLength(Vector=analyse.Displacements)
visres = VisualiseResults(Structure=analyse.AnalysedStructure, ScaleDeformation=100)  # -> DeformedMesh, VonMisesStressPlot
sort = SortList(Keys=vlen)  # -> Keys, ValuesA
item_3 = ListItem(List=sort.Keys, Index=0, Wrap=True)  # -> Item1, Item
mistran = Panel(item_3.Item1)
division_6 = Division(A=karamba, B=mistran)  # -> flatten(Result)
panel = Panel(division_6)
mesh_3 = Mesh(visres.VonMisesStressPlot)
drawcoordsys = DrawElementCoordinateSystem(Structure=analyse.AnalysedStructure)
