# Grasshopper definition Komposit_verifiering.gh (Grasshopper 0.9.76)
# plug-ins: Karamba, MiStrAnGH

number_slider = Slider(1, range=0..1)
pt = Point(Point(6.187004391, 14.76879502, 0))
rotate = Rotate(Center=Point(0, 0, 0), From=Vector(1, 0, 0), To=Vector(0, 1, 0))  # -> Geometry, Transform
vec = VectorXYZ(XComponent=number_slider, YComponent=number_slider, ZComponent=number_slider)  # -> Vector, Length
xy = XYPlane(Origin=Point(0, 0, 0))
xz = XZPlane(Origin=Point(0, 0, 0))
number_slider_2 = Slider(1, range=0..1)
number_slider_3 = Slider(10, range=0..10)
number_slider_4 = Slider(1, range=0..10)
pl = ConstructPlane(Origin=pt, XAxis=vec.Vector, YAxis=Vector(0, 1, 0))
prot = RotatePlane(Plane=xz, Angle=Slider(0.785, range=0..1))
pln = Plane(xy)
dom = ConstructDomain(DomainStart=expr("-x/2", number_slider_3), DomainEnd=expr("x/2", number_slider_3))
dom_2 = ConstructDomain(DomainStart=expr("-x/2", number_slider_4), DomainEnd=expr("x/2", number_slider_4))
number_slider_5 = Slider(3000, range=0..10000)
number_slider_6 = Slider(1000000, range=0..10000000)
number_slider_7 = Slider(40, range=0..1000)
number_slider_8 = Slider(4, range=0..10)
addition = Addition(A=number_slider_8, B=1)
planesrf = PlaneSurface(Plane=pln, XSize=dom, YSize=dom_2)
rectangle = Rectangle(Plane=pln, XSize=dom, YSize=dom_2, Radius=0)  # -> Rectangle, Length
division = Division(A=Slider(10000, range=0..10000), B=addition)
deplane = DeconstructPlane(Plane=pln)  # -> Origin, XAxis, YAxis, ZAxis
srf = Surface(planesrf)
repeat = RepeatData(Data=division, Length=addition)
mplane = MeshPlane(Boundary=rectangle.Rectangle, WidthCount=number_slider_7, HeightCount=number_slider_8)  # -> Mesh, Area
number_slider_9 = Slider(0, range=0..1)
sdivide = DivideSurface(Surface=srf, UCount=number_slider_7, VCount=number_slider_8)  # -> simplify(Points), Normals, Parameters
tstat = TreeStatistics(Tree=sdivide.Points)  # -> Paths, Length, Count
tri = Triangulate(Mesh=mplane.Mesh)  # -> Mesh, Count
item = ListItem(List=tstat.Paths, Index=0, Wrap=True)  # -> Item1, Item
demesh = DeconstructMesh(Mesh=tri.Mesh)  # -> Vertices, Faces, Colours, Normals
points = PointList(Points=demesh.Vertices, Size=Slider(0.1, range=0..1))
Z = UnitZ(Factor=-1)
branch = TreeBranch(Tree=simplify(sdivide.Points), Path=item.Item, MaintainPaths=True)  # -> flatten(Branch)
branch_2 = TreeBranch(Tree=simplify(sdivide.Points), Path=item.Item1, MaintainPaths=True)  # -> flatten(Branch)
multiplication = Multiplication(A=deplane.ZAxis, B=repeat)
vdis = VectorDisplay(Anchor=branch_2, Vector=unitize(multiplication))
demesh_2 = DeconstructMesh(Mesh=tri.Mesh)  # -> Vertices, Faces, Colours, Normals
pointload = MiStrAnPointload(Point=branch_2, ForceVector=multiplication)
medges = MeshEdges(Mesh=tri.Mesh)  # -> NakedEdges, InteriorEdges, NonManifoldEdges
panel = Panel(multiplication)
support = CreateSupport(
    Point=branch,
    SupportInXDirection=True,
    SupportInYDirection=True,
    SupportInZDirection=True,
    SupportInXXDirection=True,
    SupportInYYDirection=True,
    SupportInZZDirection=True)
gravity = MiStrAnGravityLoad()
index = ItemIndex(List=demesh_2.Faces, Item=demesh_2.Faces)
section = Section(IndexesOfFaces=index, LaminaThickness=Slider(0.1, range=0..0.1))
facen = FaceNormals(Mesh=tri.Mesh)  # -> Centers, Normals
license = LicenseKaramba()
assemble = MiStrAnAssembleStructure(Mesh=tri.Mesh, MiStrAnSupports=support, MiStrAnLoads=gravity, GeneratedSection=section)
analyse = MiStrAnAnalyseStructure(Run=Toggle(True), MiStrAnStructure=assemble)  # -> Displacements, Rotations, Reactions, DeformedMesh, PrincipalStresses
Z_2 = UnitZ(Factor="7659.6")
distload = MiStrAnDistributedLoad(CenterPoint=facen.Centers, ForceVector=Z_2)
vlen = VectorLength(Vector=analyse.Displacements)
sort = SortList(Keys=vlen)  # -> Keys, ValuesA
item_2 = ListItem(List=sort.Keys, Index=0, Wrap=True)  # -> Item1, Item
panel_2 = Panel(analyse.PrincipalStresses)
panel_3 = Panel(item_2.Item1)
