# Grasshopper definition PrincipalDirections_test.gh (Grasshopper 0.9.76)
# plug-ins: MiStrAnGH

number_slider = Slider(11, range=0..100)
srf = Surface(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)
mesh_uv = MeshSurface(Surface=srf, UCount=number_slider, VCount=number_slider, Overhang=True, Equalize=False)
tri = Triangulate(Mesh=mesh_uv)  # -> Mesh, Count
facen = FaceNormals(Mesh=tri.Mesh)  # -> Centers, Normals
demesh = DeconstructMesh(Mesh=tri.Mesh)  # -> Vertices, Faces, Colours, Normals
points = PointList(Points=facen.Centers)
medges = MeshEdges(Mesh=tri.Mesh)  # -> NakedEdges, InteriorEdges, NonManifoldEdges
pdecon = Deconstruct(Point=demesh.Vertices)  # -> XComponent, YComponent, ZComponent
cset = CreateSet(List=pdecon.XComponent)  # -> Set, Map
equals = Equality(FirstNumber=pdecon.XComponent, SecondNumber=graft(cset.Set))  # -> Equality, Inequality
cull = CullPattern(List=demesh.Vertices, CullPattern=equals.Equality)
tstat = TreeStatistics(Tree=cull)  # -> Paths, Length, Count
item = ListItem(List=tstat.Paths, Index=0, Wrap=True)  # -> Item1, Item
branch = TreeBranch(Tree=cull, Path=item.Item1, MaintainPaths=True)
branch_2 = TreeBranch(Tree=cull, Path=item.Item, MaintainPaths=True)
mesh = Mesh(tri.Mesh)
Y = UnitY(Factor=Slider(100, range=0..100))
support = CreateSupport(
    Point=branch_2,
    SupportInXDirection=True,
    SupportInYDirection=True,
    SupportInZDirection=True,
    SupportInXXDirection=True,
    SupportInYYDirection=True,
    SupportInZZDirection=True)
section = Section(
    EModulusInLongitudinalDirection_GPa=210,
    EModulusInTransverseDirection_GPA=210,
    LongitudinalShearModulus_GPA=79.3,
    PoissonsRatio=0.3,
    LaminaThickness_mm=10,
    Angles_degree=0,
    Density_kg_m_3=7800)
pointload = MiStrAnPointload(Point=branch, ForceVector=Y)
assemble = MiStrAnAssembleStructure(Mesh=mesh, MiStrAnSupports=support, MiStrAnLoads=pointload, GeneratedSection=section)
analyse = MiStrAnAnalyseStructure(Run=Toggle(True), MiStrAnStructure=assemble)  # -> AnalysedStructure, Displacements, Rotations, Reactions, PrincipalStresses
drawcoordsys = DrawElementCoordinateSystem(Structure=analyse.AnalysedStructure)
drawprincarrows = DrawPrincipalstressArrows(Structure=analyse.AnalysedStructure)
