# Grasshopper definition ShellBalk.gh (Grasshopper 0.9.76)
# plug-ins: Karamba, MiStrAnGH

number_slider = Slider(1, range=0..10)
height_width = Number(Slider(0.1, range=0..0.1))
length = Number(Slider(3, range=0..1000))
analytical = Panel("0.7326")
Z = UnitZ(Factor=height_width)
division = Division(A=Z, B=2)
dom = ConstructDomain(DomainStart=expr("-x/2", length), DomainEnd=expr("x/2", length))
dom_2 = ConstructDomain(DomainStart=expr("-x/2", height_width), DomainEnd=expr("x/2", height_width))
xy = XYPlane(Origin=Point(0, 0, 0))
xy_2 = XYPlane(Origin=Z)
xz = XZPlane(Origin=division)
mesh_density = Number(Slider(200, range=0..1000))
rectangle = Rectangle(Plane=[xy, xy_2, xz], XSize=dom, YSize=dom_2, Radius=0)  # -> Rectangle, Length
division_2 = Division(A=mesh_density, B=25)
make_even = CSharpScript(x=division_2)  # -> A; inputs x: Int32
# ---------- make_even: C# ----------
      if(x%2.0 == 0)
      A = x;
    else
      A = x + 1;
# ---------- end make_even ----------
mplane = MeshPlane(Boundary=rectangle.Rectangle, WidthCount=mesh_density, HeightCount=make_even)  # -> Mesh, Area
tri = Triangulate(Mesh=mplane.Mesh)  # -> Mesh, Count
mjoin = MeshJoin(Meshes=tri.Mesh)
cullmesh = CullMesh(M=mjoin)
mesh = Mesh(cullmesh)
medges = MeshEdges(Mesh=mesh)  # -> NakedEdges, InteriorEdges, NonManifoldEdges
demesh = DeconstructMesh(Mesh=mesh)  # -> Vertices, Faces, Colours, Normals
sort_pt = SortPoints(Points=demesh.Vertices)  # -> Points, Indices
item = ListItem(List=sort_pt.Points, Index=0, Wrap=True)  # -> Item1, Item
pdecon = Deconstruct(Point=sort_pt.Points)  # -> XComponent, YComponent, ZComponent
pdecon_2 = Deconstruct(Point=[item.Item, item.Item1])  # -> XComponent, YComponent, ZComponent
equals = Equality(FirstNumber=graft(pdecon_2.XComponent), SecondNumber=pdecon.XComponent)  # -> Equality, Inequality
cull = CullPattern(List=sort_pt.Points, CullPattern=equals.Equality)
number_slider_2 = Slider(100000, range=0..100000)
bang = ExplodeTree(Data=simplify(cull))  # -> Branch0, Branch1
Z_2 = UnitZ(Factor=expr("-x", Slider(1000, range=0..1000)))
lng = ListLength(List=bang.Branch0)
division_3 = Division(A=Z_2, B=lng)
dup = DuplicateData(Data=division_3, Number=lng, Order=True)
number_slider_3 = Slider(0.01, range=0..0.01)
loadspts = Point(bang.Branch1)
toggle = BooleanToggle(False)
bc = Point(bang.Branch0)
Z_3 = UnitZ(Factor=0)
triangle = MeshTriangle(CornerA=0, CornerB=1, CornerC=2)
vec = Vector(dup)
toggle_2 = BooleanToggle(False)
mesh_2 = Mesh(mesh)
division_4 = Division(A=vec, B=1000)
support = CreateSupport(
    Point=bc,
    SupportInXDirection=True,
    SupportInYDirection=True,
    SupportInZDirection=True,
    SupportInXXDirection=True,
    SupportInYYDirection=True,
    SupportInZZDirection=True)
meshtoshell = MeshToShellKaramba(Mesh=mesh_2, LDist=0.005, Identifier=Slider(0, range=0..100))  # -> Point, Element, Info
cross_sections = CrossSectionsKaramba(ElementsIdentifiers=meshtoshell.Element, Heights_cm=Slider(1, range=0..100), mode="Shell")
cp = ClosestPoint(Point=bc, Cloud=meshtoshell.Point)  # -> ClosestPoint, CPIndex, Distance
cp_2 = ClosestPoint(Point=loadspts, Cloud=meshtoshell.Point)  # -> ClosestPoint, CPIndex, Distance
matprops = MaterialPropertiesKaramba(
    ElementsIdentifiers=meshtoshell.Element,
    YoungsModulus_kN_cm2=21000,
    ShearModulus_kN_cm2=8076,
    SpecificWeight_kN_m3=78.5,
    CoefficientOfThermalExpansion_1_C=1e-05,
    YieldStrength_kN_cm2=23.5,
    Name="S235")
pointload = MiStrAnPointload(Point=loadspts, ForceVector_kN=vec)
section = Section(
    EModulusInLongitudinalDirection_GPa=210,
    EModulusInTransverseDirection_GPA=210,
    LongitudinalShearModulus_GPA=79.3,
    PoissonsRatio=0.3,
    LaminaThickness_mm=10,
    Angles_degree=0,
    Density_kg_m_3=7800)
loads = LoadsKaramba(ForceVector=division_4, Local=False, PosInd=cp_2.ClosestPoint, LCase=0, mode="Point")
supp = SupportKaramba(PosInd=cp.ClosestPoint, menu=[buttons(on, on, on, on, on, on)])
assemble = MiStrAnAssembleStructure(Mesh=mesh_2, MiStrAnSupports=support, MiStrAnLoads=pointload, GeneratedSection=section)
assemble_2 = AssembleModelKaramba(
    Point=meshtoshell.Point,
    Elem=meshtoshell.Element,
    Support=supp,
    Load=loads,
    CrossSection=cross_sections,
    Material=matprops,
    LimitDistance_m=0.005)  # -> Model, Info, Mass_kg, CenterOfGravity
analyse = MiStrAnAnalyseStructure(Run=Toggle(True), MiStrAnStructure=assemble)  # -> AnalysedStructure, Displacements, Rotations, Reactions, PrincipalStresses, PrincipalStressAngles, VonMisesStresses
number_slider_4 = Slider(60, range=0..1000)
analyzethi = AnalyzeThIKaramba(Model=assemble_2.Model)  # -> CalculatedModel, MaximumDisplacement_m, ResultingForceOfGravity_kN, ElasticEnergy_kNm
karamba = Panel(analyzethi.MaximumDisplacement_m)
vlen = VectorLength(Vector=analyse.Displacements)
sort = SortList(Keys=vlen)  # -> Keys, ValuesA
visres = VisualiseResults(Structure=analyse.AnalysedStructure, ScaleDeformation=100)  # -> DeformedMesh, VonMisesStressPlot, VonMisesStresses
item_2 = ListItem(List=sort.Keys, Index=0, Wrap=True)  # -> Item1, Item
nodedisp = NodalDisplacementsKaramba(AnalyzedModel=analyzethi.CalculatedModel)  # -> AnalyzedModel, NodalTranslations_m, NodalRotations_rad
drawprincarrows = DrawPrincipalstressArrows(Structure=analyse.AnalysedStructure)
mesh_3 = Mesh(visres.VonMisesStressPlot)
panel = Panel(item_2.Item1)
modelview = ModelViewKaramba(Model=nodedisp.AnalyzedModel, LoadCaseFactorsForLinearSuperposition=1, IndexIncrementOfVisibleLoadcase=0)  # -> Model, DeformedMesh, DeformedAxes, DeformedModel

# ==== cluster CullMesh
M = ClusterInput()
demesh = DeconstructMesh(Mesh=M)  # -> Vertices, Faces, Colours, Normals
deface = DeconstructFace(Face=demesh.Faces)  # -> CornerA, CornerB, CornerC, CornerD
cset = CreateSet(List=demesh.Vertices)  # -> Set, Map
index = ItemIndex(List=cset.Map, Item=cset.Map)
panel = Panel(cset.Map)
replace = ReplaceMembers(Set=deface.CornerB, Find=index, Replace=panel)
replace_2 = ReplaceMembers(Set=deface.CornerC, Find=index, Replace=panel)
replace_3 = ReplaceMembers(Set=deface.CornerA, Find=index, Replace=panel)
triangle = MeshTriangle(CornerA=replace_3, CornerB=replace, CornerC=replace_2)
conmesh = ConstructMesh(Vertices=cset.Set, Faces=triangle)
M_2 = ClusterOutput(conmesh)
