# Grasshopper definition TestCase_beam_1x10x01m.gh (Grasshopper 0.9.76)

number_slider = Slider(10, range=0..10)
number_slider_2 = Slider(1, range=0..1)
dom = ConstructDomain(DomainStart=expr("-x/2", number_slider_2), DomainEnd=expr("x/2", number_slider_2))
dom_2 = ConstructDomain(DomainStart=expr("-x/2", number_slider), DomainEnd=expr("x/2", number_slider))
planesrf = PlaneSurface(Plane=PlaneXY(0, 0, 0), XSize=dom_2, YSize=dom)
number_slider_3 = Slider(4, range=0..100)
srf = Surface(planesrf)
multiplication = Multiplication(A=number_slider_3, B=10)
sdivide = DivideSurface(Surface=srf, UCount=multiplication, VCount=number_slider_3)  # -> Points, Normals, Parameters
del = DelaunayMesh(Points=flatten(sdivide.Points), Plane=PlaneXY(0, 0, 0))
medges = MeshEdges(Mesh=del)  # -> NakedEdges, InteriorEdges, NonManifoldEdges
